# Grasshopper definition categorical_optimization.gh (Grasshopper 1.0.7)
# plug-ins: Tunny

A = Slider(0.8, range=0.1..10)
B = Slider(8.8, range=0.1..10)

# ----
# Optimization was previously based on using NumberSlider,
# but to allow for categorical optimization,
# ValueList can now be used as a variable.
# Categorical is when there is no distance between variables.
# 
# Since these are algorithms, they are independent of each other,
# so categorical optimization is appropriate
algorithmtype = ValueList({"Ad": 0, "Su": 1, "Mu": 2, "Di": 3}, selected="Su")

blackbox_function = BlackBoxFunction(G=algorithmtype, A=A, B=B)
result = Number(blackbox_function)
tunny = Tunny(Variables=[algorithmtype, A, B], Objectives=result)

# ==== cluster BlackBoxFunction
G = ClusterInput()
A = ClusterInput()
B = ClusterInput()
addition = Addition(A=A, B=B)
subtraction = Subtraction(A=A, B=B)
multiplication = Multiplication(A=A, B=B)
division = Division(A=A, B=B)
filter = StreamFilter(Gate=G, Stream0=addition, Stream1=subtraction, Stream2=multiplication, Stream3=division)
s_1 = ClusterOutput(filter)
