# Grasshopper definition sample.gh (Grasshopper 1.0.7)
# plug-ins: Tunny Info

x1 = Slider(-10, range=-10..10)
x2 = Slider(-10, range=-10..10)

# ---- group: Booth function
expression = Expression(x1=x1, x2=x2, Expression="(x1+2*x2-7)^2 + (2*x1+x2-5)^2")

# ---- group: Simple Addition
addition = Addition(A=x1, B=x2)

# ----
num = Number([expression, addition])
tunny = Tunny(Variables=[x1, x2], Objective=num)
