# Grasshopper definition sample.gh (Grasshopper 1.0.7)
# plug-ins: Tunny Info

# ----
# Support genepool
genes = GenePool(Decimals=2, Maximum=10, Minimum=-10, Value=[-9.440827508, -7.797119927, 5.427945412])

# ----
# These slider are used for optimization as a variable.
# Nickname is recommended to make the results easier to understand.
x1 = Slider(-9.22, range=-10..10)
x2 = Slider(-1.54, range=-10..10)
x3 = Slider(3.21, range=-10..10)

# ---- group: Booth function
expression = Expression(x1=x1, x2=x2, Expression="(x1+2*x2-7)^2 + (2*x1+x2-5)^2")

# ---- group: Brep Volume
pt = ConstructPoint(XCoordinate=x1, YCoordinate=x2, ZCoordinate=x3)
num2pt = NumbersToPoints(Numbers=genes, Mask=4)
box = Box2Pt(PointA=num2pt, PointB=pt, Plane=PlaneXY(0, 0, 0))
volume = Volume(Geometry=box)  # -> Volume, Centroid

# ---- group: Simple Addition
addition = Addition(A=x1, B=x2)

# ----
ln = Line(StartPoint=num2pt, EndPoint=pt)

# ----
# Multi geometry support
brep = Brep(box)
crv = Curve(ln)

# ----
# Input the objective
# value separately.
booth_function = Number(expression)
brep_volume = Number(volume.Volume)
addition_2 = Number(addition)

# ----
# Double-click the icon to open
# the optimization window.
tunny = Tunny(Variables=[x1, x2, x3, genes], Objectives=[addition_2, booth_function, brep_volume], Geometries=[brep, crv])

# ----
# The Fish component can
# handle the Tunny results.
fish = Fish([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])

fish_2 = Fish(tunny)

# ----
# Results can be arrayed in Rhino's viewport
xy = XYPlane(Origin=Point(0, 0, 0))
fmarket = FishMarket(
    Fishes=fish,
    Plane=xy,
    XNum=Slider(10, range=0..10),
    XInterval=Slider(46, range=0..100),
    YInterval=Slider(60, range=0..100),
    TextSize=1)

panel = Panel(fish)
